# Grasshopper definition Linkdin_exercise.gh (Grasshopper 1.0.7)

addition = Addition(A=Slider(2, range=0..10), B=Slider(6, range=0..10))

# ----
# MAIN COMPONENTS
panel = Panel(addition)
box_2pt = Box2Pt(PointA="0,0,0", PointB="10,10,10", Plane=PlaneXY(0, 0, 0))
# Create or Remove Group on Dependent components
sphere = Sphere(Base=PlaneXY(0, 0, 0), Radius=panel)

c_script = CSharpScript(Group=Toggle(False), x=sphere)  # -> out, AllComp, DepntComp, GUID; inputs Group: Boolean, x: Brep
# ---------- c_script: C# ----------
    //IGH_ActiveObject a = GH_ActiveObject();
    GH_Document ghdoc = this.GrasshopperDocument;

    IGH_ActiveObject a = this.Component;

    IList<IGH_Param> lis = this.Component.Params.Input[1].Sources;


    List<IGH_ActiveObject> components = GrasshopperDocument.ActiveObjects();

    List<string> AllNames = new List<string>();
    List<string> DependentComps = new List<string>();
    List<Guid> DependentCompsGuid = new List<Guid>();


    foreach (IGH_ActiveObject c in components)
    {

      AllNames.Add(c.Name);

      if(c.DependsOn(lis[0]))
      {
        CName(c, lis[0], components, ref DependentComps, ref DependentCompsGuid);
      }

    }
    AllComp = AllNames;
    DepntComp = DependentComps;

    HashSet<Guid> GuidHashSet = new HashSet<Guid>(DependentCompsGuid);
    GUID = GuidHashSet;

    Guid[] GuidArray = new Guid[GuidHashSet.Count];
    GuidHashSet.CopyTo(GuidArray);


    if(Group == true)
    {
      ghGroups.Clear();
      Grouping(GuidArray, ref ghGroups);
    }
    if(Group == false)
    {
      Ungrouping(ref ghGroups);

    }
# ---------- c_script: C# additional code ----------
  List<Grasshopper.Kernel.Special.GH_Group> ghGroups = new List<Grasshopper.Kernel.Special.GH_Group>();

  void CName(IGH_ActiveObject C1, IGH_ActiveObject C2, List<IGH_ActiveObject> components, ref List<string> DependentComps, ref List<Guid> DependentCompsGuid)
  {
    if(C1.DependsOn(C2))
    {
      DependentComps.Add(C1.Name);
      DependentCompsGuid.Add(C1.InstanceGuid);

      foreach (IGH_ActiveObject c in components)
      {
        if(c.DependsOn(C1))
        {
          CName(c, C1, components, ref DependentComps, ref DependentCompsGuid);
        }
      }
    }

  }
  void Grouping(Guid[] GuidArray, ref List<Grasshopper.Kernel.Special.GH_Group> ghGroups)
  {

    for(int i = 0; i < GuidArray.Length;i++)
    {
      Grasshopper.Kernel.Special.GH_Group GhGr = new Grasshopper.Kernel.Special.GH_Group();

      System.Drawing.Color color = System.Drawing.Color.FromArgb(255, 0, 40);
      GhGr.Colour = color;
      GhGr.Name = "";
      GhGr.NickName = "";
      GrasshopperDocument.AddObject(GhGr, false, GrasshopperDocument.ObjectCount);
      GhGr.AddObject(GuidArray[i]);
      GhGr.ExpireCaches();
      ghGroups.Add(GhGr);

    }

  }
  void Ungrouping(ref List<Grasshopper.Kernel.Special.GH_Group> ghGroups)
  {
    foreach(Grasshopper.Kernel.Special.GH_Group grp in ghGroups)
    {
      GrasshopperDocument.RemoveObject(grp, false);

    }
    ghGroups.Clear();
  }
# ---------- end c_script ----------
surface = Surface(sphere)
c_script_2 = CSharpScript(Group=Toggle(False), x=box_2pt)  # -> out, AllComp, DepntComp, GUID; inputs Group: Boolean, x: Brep; same code as c_script
deconstruct_brep = DeconstructBrep(Brep=box_2pt)  # -> Faces, Edges, Vertices
deconstruct_brep_2 = DeconstructBrep(Brep=surface)  # -> Faces, Edges, Vertices
# All Components, Dependent Components,
# GUIDS
panel_2 = Panel(c_script.GUID)
point = Point(deconstruct_brep.Vertices)
panel_3 = Panel(c_script_2.GUID)
curve = Curve(deconstruct_brep.Edges)
point_2 = Point(deconstruct_brep_2.Vertices)
curve_2 = Curve(deconstruct_brep_2.Edges)
surface_2 = Surface(deconstruct_brep.Faces)
surface_3 = Surface(deconstruct_brep_2.Faces)
box_2pt_2 = Box2Pt(PointA="0,0,0", PointB="11,10,10", Plane=PlaneXY(0, 0, 0))
button = Button()
divide_length = DivideLength(Curve=curve, Length=".4")  # -> Points, Tangents, Parameters
divide_length_2 = DivideLength(Curve=curve, Length=".4")  # -> Points, Tangents, Parameters
divide_length_3 = DivideLength(Curve=curve_2, Length=".4")  # -> Points, Tangents, Parameters
divide_length_4 = DivideLength(Curve=curve_2, Length=".4")  # -> Points, Tangents, Parameters
panel_4 = Panel(c_script.DepntComp)
important = CSharpScript(ComponentINP=box_2pt_2, IntialPoint=button)  # -> out, Names, TimeTaken, Condition, ComponentOut; inputs IntialPoint: Boolean
# ---------- important: C# usings ----------
using System.Drawing;
# ---------- important: C# ----------
    if(IntialPoint == true)
    {
      Name.Clear();
      Time.Clear();
      phase.Clear();
      components.Clear();


    }
    components = GrasshopperDocument.ActiveObjects();


    foreach (IGH_ActiveObject c in components)
    {

      Time.Add(c.ProcessorTime.Milliseconds);
      Name.Add(c.Name);
      phase.Add(c.Phase);


    }

    TimeTaken = Time;
    Names = Name;
    Condition = phase;
    ComponentOut = ComponentINP;
# ---------- important: C# additional code ----------
  List<string> Name = new List<string>();
  List<int> Time = new List<int>();
  List<GH_SolutionPhase> phase = new List<GH_SolutionPhase>();

  List<IGH_ActiveObject> components;
# ---------- end important ----------
panel_5 = Panel(c_script_2.DepntComp)
line = Line(StartPoint=divide_length.Points, EndPoint=divide_length_2.Points)
panel_6 = Panel(c_script.AllComp)
line_2 = Line(StartPoint=divide_length_3.Points, EndPoint=divide_length_4.Points)
panel_7 = Panel(c_script_2.AllComp)
point_3 = Point(divide_length_4.Points)
deconstruct_brep_3 = DeconstructBrep(Brep=important.ComponentOut)  # -> Faces, Edges, Vertices
line_3 = Line(line)
line_4 = Line(line_2)
point_4 = Point(deconstruct_brep_3.Vertices)
curve_3 = Curve(deconstruct_brep_3.Edges)
surface_4 = Surface(deconstruct_brep_3.Faces)
divide_length_5 = DivideLength(Curve=curve_3, Length="5")  # -> Points, Tangents, Parameters
divide_length_6 = DivideLength(Curve=curve_3, Length="5")  # -> Points, Tangents, Parameters
panel_8 = Panel(important.Condition)
line_5 = Line(StartPoint=divide_length_5.Points, EndPoint=divide_length_6.Points)  # -> simplify(flatten(Line))
important_2 = CSharpScript(ComponentINP=line_5, FinalPoint=button)  # -> out, Names, TimeTaken, Condition, ComponentOut; inputs ComponentINP: list, FinalPoint: Boolean
# ---------- important_2: C# ----------
    if(FinalPoint == true)
    {
      Name.Clear();
      Time.Clear();
      phase.Clear();
      components.Clear();


    }
    components = GrasshopperDocument.ActiveObjects();


    foreach (IGH_ActiveObject c in components)
    {

      Time.Add(c.ProcessorTime.Milliseconds);
      Name.Add(c.Name);
      phase.Add(c.Phase);


    }

    TimeTaken = Time;
    Names = Name;
    Condition = phase;
    ComponentOut = ComponentINP;
# ---------- important_2: C# additional code ----------
  List<string> Name = new List<string>();
  List<int> Time = new List<int>();
  List<GH_SolutionPhase> phase = new List<GH_SolutionPhase>();

  List<IGH_ActiveObject> components;
# ---------- end important_2 ----------
panel_9 = Panel(important_2.Condition)
c_script_3 = CSharpScript(x=panel_8, y=panel_9)  # -> out, A; inputs x: list, y: list
# ---------- c_script_3: C# ----------
    List<string> Status = new List<string>();
    for(int i = 0; i < x.Count;i++)
    {
      if(x[i] == y[i])
      {
        Status.Add("Not Updated");
      }

      else if(x[i] != y[i])
      {
        Status.Add("Updated");
      }
    }

    A = Status;
# ---------- end c_script_3 ----------
panel_10 = Panel(c_script_3.A)
