# Grasshopper definition TeklaUDA.gh (Grasshopper 1.0.7)

attriname_type_value = Panel("""UDA991~Str~a
UDA994~Str~a
UDA995~Dou~59.5
UDA998~Dou~58.888""")
value_list = ValueList({"Excel": 1, "Element Name": 2, "Tekla Selection": 3}, selected="Excel")
value_list_2 = ValueList({"Name": 1, "Material": 2, "Prefix": 3}, selected="Prefix")
file_path = FilePath("C:\Users\User\Desktop\Attributes.xlsx")
set_tekla_attributes = CSharpScript(
    Reset=Button(),
    Mode=value_list,
    ExcelPath=file_path,
    Criterion=value_list_2,
    InputName="AA",
    Attri_Name_Type_Value=attriname_type_value,
    Reference=["C:\Program Files (x86)\Microsoft Office\root\Office16\ADDINS\Microsoft Power Query for Excel Integrated\bin\Microsoft.Office.Interop.Excel.dll", "C:\Program Files\Tekla Structures\2022.0\bin\Tekla.Structures.Model.dll", "C:\Program Files\Tekla Structures\2022.0\bin\Tekla.Structures.Geometry3d.Compatibility.dll", "C:\Program Files\Tekla Structures\2022.0\bin\Tekla.Structures.dll", "C:\Program Files\Tekla Structures\2022.0\bin\Tekla.Structures.Catalogs.dll", "C:\Program Files\Tekla Structures\2022.0\bin\Tekla.Structures.Drawing.dll"])  # -> out, Elements, AttriNames, AttriType, E; inputs Mode: Int32, ExcelPath: String, Criterion: Int32, InputName: String, Attri_Name_Type_Value: list of String
# ---------- set_tekla_attributes: C# usings ----------
using Microsoft.Office.Interop.Excel;

using System.ComponentModel;
using System.Data;
using System.Drawing;
using System.Linq;
using System.Reflection;
using System.Text;
using System.Threading.Tasks;
using System.Windows.Forms;
using TSM=Tekla.Structures.Model;
using Tekla.Structures.Drawing;
//using Tekla.Structures.ide;

using TSMUI = Tekla.Structures.Model.UI;
using TSG = Tekla.Structures.Geometry3d;
using Tekla.Structures.Catalogs;
using Object = Tekla.Structures.Model.Object;
using System.Xml.Linq;
using Tekla.Structures.Model;
using TSF=Tekla.Structures.Filtering;
# ---------- set_tekla_attributes: C# ----------
    int C = Criterion;
    if(Mode == 1)
    {
      UpdateSta.Clear();
      ElementNames.Clear();
      AttributesNames.Clear();
      AttributesValues.Clear();
      Attributestype.Clear();

      OpenWorkbook(ExcelPath, ref ElementNames, ref AttributesNames, ref Attributestype, ref AttributesValues, oExcel);

      SetUDAs(ElementNames, AttributesNames, Attributestype, AttributesValues, C, ref UpdateSta);
      SetReinUDAs(ElementNames, AttributesNames, Attributestype, AttributesValues, C, ref UpdateSta);

    }
    if(Mode == 2)
    {
      UpdateSta.Clear();
      ElementNames.Clear();
      AttributesNames.Clear();
      AttributesValues.Clear();
      Attributestype.Clear();
      ElementNames.Add(InputName);

      GetNamesAndVal(Attri_Name_Type_Value, ref AttributesNames, ref Attributestype, ref AttributesValues);

      SetUDAs(ElementNames, AttributesNames, Attributestype, AttributesValues, C, ref UpdateSta);
      SetReinUDAs(ElementNames, AttributesNames, Attributestype, AttributesValues, C, ref UpdateSta);
    }
    if(Mode == 3)
    {
      UpdateSta.Clear();
      ElementNames.Clear();
      AttributesNames.Clear();
      AttributesValues.Clear();
      Attributestype.Clear();
      GetSelectedItem(ref ElementNames);
      GetNamesAndVal(Attri_Name_Type_Value, ref AttributesNames, ref Attributestype, ref AttributesValues);

      SetUDAs(ElementNames, AttributesNames, Attributestype, AttributesValues, C, ref UpdateSta);
      SetReinUDAs(ElementNames, AttributesNames, Attributestype, AttributesValues, C, ref UpdateSta);
    }

    Elements = ElementNames;
    AttriNames = AttributesNames;
    AttriType = Attributestype;
    //D = AttributesValues[0];
    E = UpdateSta;
# ---------- set_tekla_attributes: C# additional code ----------
  Microsoft.Office.Interop.Excel.Application oExcel = new Microsoft.Office.Interop.Excel.Application();
  List<string> ElementNames = new List<string>();
  List< Tekla.Structures.Identifier> IdentifierList = new List< Tekla.Structures.Identifier>();
  List<string> AttributesNames = new List<string>();
  List<List<string>> AttributesValues = new List<List<string>>();
  List<string> Attributestype = new List<string>();
  List<bool> UpdateSta = new List<bool>();


  TSM.Model TKModel = new TSM.Model();


  public static void OpenWorkbook(string ExcelPath, ref List<string> ElementNames, ref List<string> AttributesNames, ref List<string> Attributestype, ref List<List<string>> AttributesValues, Microsoft.Office.Interop.Excel.Application oExcel)
  {
    string filepath = ExcelPath;
    Microsoft.Office.Interop.Excel.Workbook WB = oExcel.Workbooks.Open(filepath);
    string ExcelWorkbookname = WB.Name;
    Microsoft.Office.Interop.Excel.Worksheet wks = (Microsoft.Office.Interop.Excel.Worksheet) WB.Worksheets[1];

    /////Read excel
    Range C1 = (Range) wks.Range[wks.Cells[3, 1], wks.Cells[50, 1]];   ///Elements names
    Range R2 = (Range) wks.Range[wks.Cells[2, 2], wks.Cells[2, 50]];   ///UDA names
    Range R1 = (Range) wks.Range[wks.Cells[1, 2], wks.Cells[1, 50]];   ///UDA type

    object holderC1 = C1.Value2;
    object holderR2 = R2.Value2;
    object holderR1 = R1.Value2;

    IList collectionC1 = (IList) holderC1;
    IList collectionR2 = (IList) holderR2;
    IList collectionR1 = (IList) holderR1;

    IEnumerator emC1 = collectionC1.GetEnumerator();
    IEnumerator emR2 = collectionR2.GetEnumerator();
    IEnumerator emR1 = collectionR1.GetEnumerator();

    while(emC1.MoveNext() == true && emC1.Current != null)
    {
      ElementNames.Add(emC1.Current.ToString());
    }

    while(emR2.MoveNext() == true && emR2.Current != null)
    {
      AttributesNames.Add(emR2.Current.ToString());
    }

    while(emR1.MoveNext() == true && emR1.Current != null)
    {
      Attributestype.Add(emR1.Current.ToString());
    }
    //////

    int NumOfEle = ElementNames.Count; int NumOfAttri = AttributesNames.Count;

    for(int i = 0;i < NumOfEle;i++)
    {
      List<string> values = new List<string>();

      for(int j = 0;j < NumOfAttri;j++)
      {
        int Ro = i + 3;
        int Co = j + 2;
        Range R = (Range) wks.Cells[Ro, Co];
        if (R.Value2 != null)

        {string v = Convert.ToString(R.Value2);
          values.Add(v);}
        else{values.Add(" ");}

      }
      AttributesValues.Add(values);
    }

    WB.Close(0);
  }

  public static void GetSelectedItem(ref List<string> ElementNames)
  {
    ModelObjectEnumerator selectedModelObjects = new TSMUI.ModelObjectSelector().GetSelectedObjects();
    while(selectedModelObjects.MoveNext() == true && selectedModelObjects.Current != null)
    {
      try
      {
        Tekla.Structures.Model.Part Assemb = selectedModelObjects.Current as Tekla.Structures.Model.Part;

        ElementNames.Add(Assemb.Name);

      }
      catch
      {
        Tekla.Structures.Model.Reinforcement Assemb = selectedModelObjects.Current as Tekla.Structures.Model.Reinforcement;
        ElementNames.Add(Assemb.Name);

      }
    }
  }

  public static void GetNamesAndVal(List<string> Attri_Name_Type_Value, ref List<string> AttributesNames, ref List<string> Attributestype, ref List<List<string>> AttributesValues)
  {
    List < string> val = new List<string>();
    foreach(string str in Attri_Name_Type_Value)
    {
      string[] subs = str.Split('~');
      AttributesNames.Add(subs[0]);
      Attributestype.Add(subs[1]);
      val.Add(subs[2]);
    }
    AttributesValues.Add(val);

  }


  public static void SetUDAs(List<string> ElementNames, List<string> AttributesNames, List<string> Attributestype, List<List<string>> AttributesValues, int C, ref List<bool> UpdateSta)
  {
    TSM.Model TKModel1 = new TSM.Model();
    ModelObjectSelector Selector1 = TKModel1.GetModelObjectSelector();
    for(int i = 0; i < ElementNames.Count;i++)
    {
      TSF.BinaryFilterExpression FilterEx = null;
      if(C == 1)
      {
        FilterEx = new TSF.BinaryFilterExpression(new TSF.Categories.PartFilterExpressions.Name(), TSF.StringOperatorType.IS_EQUAL, new TSF.StringConstantFilterExpression(ElementNames[i]));
      }
      else if(C == 2)
      {
        FilterEx = new TSF.BinaryFilterExpression(new TSF.Categories.PartFilterExpressions.Material(), TSF.StringOperatorType.IS_EQUAL, new TSF.StringConstantFilterExpression(ElementNames[i]));
      }
      else if(C == 3)
      {
        FilterEx = new TSF.BinaryFilterExpression(new TSF.Categories.PartFilterExpressions.Prefix(), TSF.StringOperatorType.IS_EQUAL, new TSF.StringConstantFilterExpression(ElementNames[i]));
      }

      ModelObjectEnumerator Enum = Selector1.GetObjectsByFilter(FilterEx);

      while (Enum.MoveNext() == true )
      {
        if (Enum.Current != null)
        {
          Tekla.Structures.Model.ModelObject Asemb1;


          Asemb1 = Enum.Current as  Tekla.Structures.Model.Part;

          //if (Asemb1 == null)
          //{

          //Asemb1 = Enum.Current as  Tekla.Structures.Model.Part;
          //UpdateSta.Add(true);
          //}


          if (Asemb1 != null)
          {

            for(int j = 0;j < AttributesNames.Count;j++)
            {

              if (Attributestype[j] == "Int" && AttributesValues[i][j] != " ")
              {
                int INTEGER = Convert.ToInt32(AttributesValues[i][j]);
                bool TF = Asemb1.SetUserProperty(AttributesNames[j], INTEGER);

              }

              else if (Attributestype[j] == "Str" && AttributesValues[i][j] != " ")
              {
                //string STRING = Convert.ToString(AttributesValues[i][j]);
                bool TF = Asemb1.SetUserProperty(AttributesNames[j], AttributesValues[i][j]);

              }

              else if (Attributestype[j] == "Dou" && AttributesValues[i][j] != " ")
              {
                double D = Convert.ToDouble(AttributesValues[i][j]);
                bool TF = Asemb1.SetUserProperty(AttributesNames[j], D);
              }
            }
          }
        }
      }
    }
  }

  public static void SetReinUDAs(List<string> ElementNames, List<string> AttributesNames, List<string> Attributestype, List<List<string>> AttributesValues, int C, ref List<bool> UpdateSta)
  {
    TSM.Model TKModel1 = new TSM.Model();
    ModelObjectSelector Selector1 = TKModel1.GetModelObjectSelector();
    for(int i = 0; i < ElementNames.Count;i++)
    {
      TSF.BinaryFilterExpression FilterEx = null;
      if(C == 1)
      {
        FilterEx = new TSF.BinaryFilterExpression(new TSF.Categories.ReinforcingBarFilterExpressions.Name(), TSF.StringOperatorType.IS_EQUAL, new TSF.StringConstantFilterExpression(ElementNames[i]));
      }
      else if(C == 2)
      {
        FilterEx = new TSF.BinaryFilterExpression(new TSF.Categories.ReinforcingBarFilterExpressions.Material(), TSF.StringOperatorType.IS_EQUAL, new TSF.StringConstantFilterExpression(ElementNames[i]));
      }
      else if(C == 3)
      {
        FilterEx = new TSF.BinaryFilterExpression(new TSF.Categories.ReinforcingBarFilterExpressions.Prefix(), TSF.StringOperatorType.IS_EQUAL, new TSF.StringConstantFilterExpression(ElementNames[i]));

      }

      ModelObjectEnumerator Enum = Selector1.GetObjectsByFilter(FilterEx);

      while (Enum.MoveNext() == true )
      {
        if (Enum.Current != null)
        {
          Tekla.Structures.Model.ModelObject Asemb1;

          Asemb1 = Enum.Current as  Tekla.Structures.Model.Reinforcement;

          if (Asemb1 != null)
          {

            for(int j = 0;j < AttributesNames.Count;j++)
            {

              if (Attributestype[j] == "Int" && AttributesValues[i][j] != " ")
              {
                int INTEGER = Convert.ToInt32(AttributesValues[i][j]);
                bool TF = Asemb1.SetUserProperty(AttributesNames[j], INTEGER);

              }

              else if (Attributestype[j] == "Str" && AttributesValues[i][j] != " ")
              {
                //string STRING = Convert.ToString(AttributesValues[i][j]);
                bool TF = Asemb1.SetUserProperty(AttributesNames[j], AttributesValues[i][j]);

              }

              else if (Attributestype[j] == "Dou" && AttributesValues[i][j] != " ")
              {
                double D = Convert.ToDouble(AttributesValues[i][j]);
                bool TF = Asemb1.SetUserProperty(AttributesNames[j], D);
              }
            }
          }
        }
      }
    }
  }
# ---------- end set_tekla_attributes ----------
panel = Panel(set_tekla_attributes.Elements)
panel_2 = Panel(set_tekla_attributes.AttriNames)
